# Grasshopper definition Circular Backdrop.gh (Grasshopper 1.0.7)

division = Division(A=Slider(100, range=0..100), B=2)
X = UnitX(Factor=Slider(30, range=0..200))
multiplication = Multiplication(A=division, B=-1)
rad = Radians(Degrees=Slider(180, range=0..360))

pt = ConstructPoint(XCoordinate=0, YCoordinate=0, ZCoordinate=0)
pt_2 = ConstructPoint(XCoordinate=division, YCoordinate=0, ZCoordinate=0)
pt_3 = ConstructPoint(XCoordinate=0, YCoordinate=multiplication, ZCoordinate=0)
pt_4 = ConstructPoint(XCoordinate=0, YCoordinate=division, ZCoordinate=0)

pt_5 = ConstructPoint(XCoordinate=0, YCoordinate=multiplication, ZCoordinate=0)

ln = Line(StartPoint=pt_2, EndPoint=pt)
vec2pt = Vector2Pt(PointA=pt, PointB=pt_3, Unitize=False)  # -> Vector, Length
ln_2 = Line(StartPoint=pt, EndPoint=pt_3)

rotax = RotateAxis(Geometry=ln, Angle=degrees(Slider(111, range=30..150)), Axis=ln_2)  # -> Geometry, Transform
move = Move(Geometry=pt_2, Motion=vec2pt.Vector)  # -> Geometry, Transform
move_2 = Move(Geometry=move.Geometry, Motion=X)  # -> Geometry, Transform
join = JoinCurves(Curves=[rotax.Geometry, ln], Preserve=False)
fillet = Fillet(Curve=join, Radius=Slider(20, range=0..20))
Z = UnitZ(Factor=100)
move_3 = Move(Geometry=move_2.Geometry, Motion=Z)  # -> Geometry, Transform
move_4 = Move(Geometry=fillet, Motion=vec2pt.Vector)  # -> Geometry, Transform
ln_3 = Line(StartPoint=move_3.Geometry, EndPoint=move_2.Geometry)
revsrf = Revolution(Curve=move_4.Geometry, Axis=ln_3, Domain=rad)
brep = Brep(revsrf)
