# Grasshopper definition Flat Backdrop.gh (Grasshopper 1.0.7)

division = Division(A=Slider(100, range=0..100), B=2)
pt = ConstructPoint(XCoordinate=0, YCoordinate=division, ZCoordinate=0)
pt_2 = ConstructPoint(XCoordinate=0, YCoordinate=0, ZCoordinate=0)
pt_3 = ConstructPoint(XCoordinate=division, YCoordinate=0, ZCoordinate=0)

multiplication = Multiplication(A=division, B=-1)
pt_4 = ConstructPoint(XCoordinate=0, YCoordinate=multiplication, ZCoordinate=0)
vec2pt = Vector2Pt(PointA=pt_2, PointB=pt_4, Unitize=False)  # -> Vector, Length

ln = Line(StartPoint=pt_3, EndPoint=pt_2)
vec2pt_2 = Vector2Pt(PointA=pt_4, PointB=pt, Unitize=False)  # -> Vector, Length
ln_2 = Line(StartPoint=pt_2, EndPoint=pt_4)
rotax = RotateAxis(Geometry=ln, Angle=degrees(Slider(111, range=30..150)), Axis=ln_2)  # -> Geometry, Transform
join = JoinCurves(Curves=[rotax.Geometry, ln], Preserve=False)
fillet = Fillet(Curve=join, Radius=Slider(20, range=0..20))
move = Move(Geometry=fillet, Motion=vec2pt.Vector)  # -> Geometry, Transform
extr = Extrude(Base=move.Geometry, Direction=vec2pt_2.Vector)
brep = Brep(extr)
